# Grasshopper definition assembled_speckle.gh (Grasshopper 1.0.7)
# plug-ins: eleFront, Speckle 2, Rhino.Inside for Autodesk Revit, treesloth01, Nautilus

# ---- group: BIMSC-PROJECT
# Send a message to James M. to add
# new materials. This list will be updated
# for all groups to have a common material
# library and common material names.
panel = Panel("ELEMENTAL MARS")
bimsc_project = Text(panel)

# ---- group: RECEIVE MATERIALS
# RECIEVE
# MATERIALS
panel_2 = Panel("https://macad.speckle.xyz/projects/4975f9f0a8/models/d59a568f9e")
receive = Receive(
    Stream=panel_2,
    AutoReceive=False,
    CurrentComponentState="up_to_date",
    ExpandOutput=True,
    LastInfoMessage="James McBennett @ 03/02/2024 01:57:29: Materials 01-03-2024 (id:6ecf38526e)",
    ReceiveOnOpen=False,
    ReceivedCommitId="6ecf38526e",
    StreamWrapper="https://macad.speckle.xyz/projects/4975f9f0a8/models/d59a568f9e",
    selectedKitName="Objects")  # -> Info, Materials
dso = DeconstructSpeckleObject(SpeckleObject=receive.Materials, selectedKitName="Objects")  # -> Glass, Inflatable, Insulation, Mineral, Regolith, Site, Soil, Steel

# ---- group: FLOOR_LEVELS
# Set your 'Project' name, your 'Group'
# number, your 'Volume' Location that
# connect wirelessly.
series = Series(Start=0, Step=1, Count="5")
expression = Expression(x=series, Expression="Format(\"{0:00}\", x)")
concat = Concatenate(FragmentA="L", FragmentB=expression)  # -> simplify(graft(Result))
floor_levels = Text(concat)

# ----
# ASSEMBLY PHASES
number_slider = Slider(8, range=1..8)
series_2 = Series(Start=1, Step=1, Count=number_slider)
item = ListItem(List=series_2, Index=0, Wrap=True)  # -> Item, Item1, Item2, Item3, Item4, Item5, Item6, Item7

# ---- group: BIMSC-ORIGINATOR
bimsc_originator = Text("G06")

# ---- group: WorksForBrepsAndMeshes
list = ValueList({"Srf/Brep": 0, "Mesh": 1}, selected="Mesh")

# ---- group: BIMSC-VOLUME
bimsc_volume = Text("A4")

# ---- group: PHASE 1
num = Number(item.Item)

# ---- group: PHASE 2
num_2 = Number(item.Item1)

# ---- group: PHASE 3
num_3 = Number(item.Item2)

# ---- group: PHASE 4
num_4 = Number(item.Item3)

# ---- group: PHASE 5
num_5 = Number(item.Item4)

# ---- group: PHASE 6
num_6 = Number(item.Item5)

# ---- group: PHASE 8
num_7 = Number(item.Item7)

# ---- group: PHASE 7
num_8 = Number(item.Item6)

# ---- group: All Blocks for Pods
# UNITS BLOCKS
panel_3 = Panel("Default")
reflay = ReferenceByLayer(LayerName=panel_3, lightweight=False)  # -> simplify(graft(Geometry))
block_info = GetBlockInfo(Block=reflay)  # -> Name, simplify(Plane), Transform, BlockType, FilePath, Active
pt = Point(block_info.Plane)
bang = ExplodeTree(Data=reflay)  # -> Branch0, Branch1, Branch2

# ----
# UNITS
panel_4 = Panel("UnitsRawVolumes")
reflay_2 = ReferenceByLayer(LayerName=panel_4, lightweight=False)
volume = Volume(Geometry=reflay_2)  # -> Volume, Centroid
int = Integer(volume.Volume)
cset = CreateSet(List=int)  # -> Set, Map
cset_2 = CreateSet(List=cset.Map)  # -> Set, Map
mindex = MemberIndex(Set=cset.Map, Member=cset_2.Set)  # -> Index, Count
item_2 = ListItem(List=reflay_2, Index=mindex.Index, Wrap=True)  # -> simplify(Item)
bang_2 = ExplodeTree(Data=item_2)  # -> Branch0, Branch1

# ----
# PHASE 2 (50P) - HUMANS / MACHINE COLLABORATION
panel_5 = Panel("")
# PHASE 1 (50p)- NO HUMANS
panel_6 = Panel("")

# ---- group: All Blocks for Pods / Units Planes
bang_3 = ExplodeTree(Data=pt)  # -> Branch0, Branch1, Branch2

# ----
area = Area(Geometry=bang_2.Branch1)  # -> Area, Centroid
prox = Proximity3D(Points=area.Centroid, Group="2", MaxRadius="5")  # -> simplify(Links), Topology
clean = CleanTree(RemoveNulls=True, RemoveInvalid=True, RemoveEmpty=True, Tree=prox.Links)
tstat = TreeStatistics(Tree=clean)  # -> Paths, Length, Count
duplines = RemoveDuplicateLines(Lines=flatten(clean), Tolerance=0.01)  # -> graft(Lines)
split = SplitTree(Data=simplify(graft(bang_2.Branch1)), Masks=flatten(tstat.Paths))  # -> graft(Positive), flatten(Negative)

# ----
# ADD ROOF
# ASSEMBLY PHASE 8
panel_7 = Panel("Roof")
reflay_3 = ReferenceByLayer(LayerName=panel_7, lightweight=False, DisableAutoUpdate=False)
mesh = Mesh(reflay_3)
faceb = FaceBoundaries(Mesh=mesh)
boundary = BoundarySurfaces(Edges=faceb)
join = BrepJoin(Breps=boundary)  # -> Breps, Closed
mesh_2 = Mesh(reflay_3)
phase = Panel(num_7)
filter = StreamFilter(Gate=list, Stream0=join.Breps, Stream1=mesh_2)  # -> reverse(simplify(graft(Stream)))
cso = CreateSpeckleObject(Roof=filter, selectedKitName="Objects")
name = ExtendSpeckleObject(
    SpeckleObject=cso,
    BIMSCPROJECT=bimsc_project,
    BIMSCORIGINATOR=bimsc_originator,
    BIMSCVOLUME=bimsc_volume,
    BIMSCTYPE="ROOF",
    BIMSCMATERIAL="Inflatable",
    RenderMaterial=dso.Inflatable,
    BIMSCPHASE=phase,
    selectedKitName="Objects")

# ----
# SORTING UNITS BY VOLUME
end = EndPoints(Curve=simplify(duplines))  # -> Start, End
pdecon = Deconstruct(Point=[end.Start, end.End])  # -> XComponent, YComponent, ZComponent
int_2 = Integer(pdecon.ZComponent)
bnd = Bounds(Numbers=int_2)
dedomain = DeconstructDomain(Domain=bnd)  # -> Start, End
equals = Equality(FirstNumber=int_2, SecondNumber=dedomain.Start)  # -> Equality, Inequality
volume_2 = Volume(Geometry=split.Positive)  # -> Volume, simplify(flatten(Centroid))
cull = CullPattern(List=[end.Start, end.End], CullPattern=equals.Equality)
cp = ClosestPoint(Point=cull, Cloud=volume_2.Centroid)  # -> ClosestPoint, CPIndex, Distance
item_3 = ListItem(List=flatten(split.Positive), Index=cp.CPIndex, Wrap=True)
debrep = DeconstructBrep(Brep=item_3)  # -> Faces, Edges, Vertices
area_2 = Area(Geometry=debrep.Faces)  # -> Area, Centroid
pdecon_2 = Deconstruct(Point=area_2.Centroid)  # -> XComponent, YComponent, ZComponent
int_3 = Integer(pdecon_2.ZComponent)
bnd_2 = Bounds(Numbers=int_3)
dedomain_2 = DeconstructDomain(Domain=bnd_2)  # -> Start, End
equals_2 = Equality(FirstNumber=int_3, SecondNumber=dedomain_2.Start)  # -> Equality, Inequality
cull_2 = CullPattern(List=debrep.Faces, CullPattern=equals_2.Equality)  # -> simplify(List)
subtraction = Subtraction(A=dedomain.Start, B=dedomain.End)
wires = BrepWireframe(Brep=cull_2, Density=-1)
division = Division(A=subtraction, B="2")
abs = Absolute(Value=subtraction)
Z = UnitZ(Factor=division)
move = Move(Geometry=cull, Motion=Z)  # -> Geometry, Transform
project = Project(Geometry=wires, Plane=move.Geometry)  # -> simplify(Geometry), Transform

phase_2 = Panel(num_8)
phase_3 = Panel(num_5)
phase_4 = Panel(num_6)
phase_5 = Panel(num)

end_2 = EndPoints(Curve=project.Geometry)  # -> Start, End
multiplication = Multiplication(A=abs, B="2")
cullpt = CullDuplicates(Points=[end_2.Start, end_2.End], Tolerance=0.1, CullMode=3)  # -> Points, Indices, Valence
pline = PolyLine(Vertices=cullpt.Points, Closed=True)  # -> simplify(Polyline)
Z_2 = UnitZ(Factor=multiplication)
extr = Extrude(Base=pline, Direction=Z_2)
cap = CapHoles(Brep=extr)

# ---- group: Units_Buffer
# UNITS PLANES
debrep_2 = DeconstructBrep(Brep=bang_2.Branch0)  # -> Faces, Edges, Vertices
area_3 = Area(Geometry=debrep_2.Faces)  # -> Area, Centroid
pdecon_3 = Deconstruct(Point=area_3.Centroid)  # -> XComponent, YComponent, ZComponent
int_4 = Integer(pdecon_3.ZComponent)
bnd_3 = Bounds(Numbers=int_4)
dedomain_3 = DeconstructDomain(Domain=bnd_3)  # -> Start, End
equals_3 = Equality(FirstNumber=int_4, SecondNumber=dedomain_3.Start)  # -> Equality, Inequality
cull_3 = CullPattern(List=area_3.Centroid, CullPattern=equals_3.Equality)  # -> simplify(List)
pln = Plane(flatten(cull_3))

pln_2 = Plane(flatten(cull_3))

# ---- group: Units_Support
debrep_3 = DeconstructBrep(Brep=cap)  # -> Faces, Edges, Vertices
area_4 = Area(Geometry=debrep_3.Faces)  # -> Area, Centroid
pdecon_4 = Deconstruct(Point=area_4.Centroid)  # -> XComponent, YComponent, ZComponent
int_5 = Integer(pdecon_4.ZComponent)
bnd_4 = Bounds(Numbers=int_5)
dedomain_4 = DeconstructDomain(Domain=bnd_4)  # -> Start, End
equals_4 = Equality(FirstNumber=int_5, SecondNumber=dedomain_4.Start)  # -> Equality, Inequality
cull_4 = CullPattern(List=area_4.Centroid, CullPattern=equals_4.Equality)  # -> simplify(List)
pln_3 = Plane(flatten(cull_4))

pln_4 = Plane(flatten(cull_4))

# ----
# BUFFER UNITS
# ASSEMBLY PHASE 5
expblock = ExplodeBlock(Block=bang.Branch1, recursive=False)  # -> Name, Transform, Geometry
detatt = DetachAttributes(Geometry=expblock.Geometry)  # -> Geometry, Attributes
volume_3 = Volume(Geometry=detatt.Geometry)  # -> Volume, Centroid
cset_3 = CreateSet(List=volume_3.Volume)  # -> Set, Map
cset_4 = CreateSet(List=cset_3.Map)  # -> Set, Map
mindex_2 = MemberIndex(Set=cset_3.Map, Member=cset_4.Set)  # -> Index, Count
item_4 = ListItem(List=detatt.Geometry, Index=mindex_2.Index, Wrap=True)  # -> simplify(Item)
bang_4 = ExplodeTree(Data=item_4)  # -> Branch0, Branch1, Branch2
sso = BlockDefinition(
    Name="Glass",
    Geometry=bang_4.Branch0,
    BasePoint=bang_3.Branch1,
    SelectedConstructorName="Objects.Other.BlockDefinition.ctor(System.String,System.Collections.Generic.List`1[Speckle.Core.Models.Base],Objects.Geometry.Point)",
    SelectedTypeName="Objects.Other.BlockDefinition",
    UseSchemaTag=False,
    UserSetSchemaTag=False,
    seed="c3e00cf1e113ee790956")
sso_2 = BlockDefinition(
    Name="Inflatable",
    Geometry=bang_4.Branch1,
    BasePoint=bang_3.Branch1,
    SelectedConstructorName="Objects.Other.BlockDefinition.ctor(System.String,System.Collections.Generic.List`1[Speckle.Core.Models.Base],Objects.Geometry.Point)",
    SelectedTypeName="Objects.Other.BlockDefinition",
    UseSchemaTag=False,
    UserSetSchemaTag=False,
    seed="a06898b9aae7d5b59163")
sso_3 = BlockDefinition(
    Name="Steel",
    Geometry=bang_4.Branch2,
    BasePoint=bang_3.Branch1,
    SelectedConstructorName="Objects.Other.BlockDefinition.ctor(System.String,System.Collections.Generic.List`1[Speckle.Core.Models.Base],Objects.Geometry.Point)",
    SelectedTypeName="Objects.Other.BlockDefinition",
    UseSchemaTag=False,
    UserSetSchemaTag=False,
    seed="bf22bfac7f0cb1c82614")
pt_2 = Point(pln_4)
orient = Orient(Geometry=bang.Branch1, Source=bang_3.Branch1, Target=pt_2)  # -> Geometry, Transform
sso_4 = BlockInstance(
    BlockDefinition=sso,
    Transform=orient.Transform,
    SelectedConstructorName="Objects.Other.BlockInstance.ctor(Objects.Other.BlockDefinition,Objects.Other.Transform)",
    SelectedTypeName="Objects.Other.BlockInstance",
    UseSchemaTag=False,
    UserSetSchemaTag=False,
    seed="b29bcd91531f56f9eb1f")
sso_5 = BlockInstance(
    BlockDefinition=sso_2,
    Transform=orient.Transform,
    SelectedConstructorName="Objects.Other.BlockInstance.ctor(Objects.Other.BlockDefinition,Objects.Other.Transform)",
    SelectedTypeName="Objects.Other.BlockInstance",
    UseSchemaTag=False,
    UserSetSchemaTag=False,
    seed="6c22e30deca8216941c1")
sso_6 = BlockInstance(
    BlockDefinition=sso_3,
    Transform=orient.Transform,
    SelectedConstructorName="Objects.Other.BlockInstance.ctor(Objects.Other.BlockDefinition,Objects.Other.Transform)",
    SelectedTypeName="Objects.Other.BlockInstance",
    UseSchemaTag=False,
    UserSetSchemaTag=False,
    seed="f42b875f65374629faa6")
name_2 = ExtendSpeckleObject(
    SpeckleObject=sso_4,
    BIMSCPROJECT=bimsc_project,
    BIMSCORIGINATOR=bimsc_originator,
    BIMSCVOLUME=bimsc_volume,
    BIMSCTYPE="STRUCTURE",
    BIMSCMATERIAL="Glass",
    RenderMaterial=dso.Glass,
    BIMSCPHASE=phase_3,
    selectedKitName="Objects")
name_3 = ExtendSpeckleObject(
    SpeckleObject=sso_5,
    BIMSCPROJECT=bimsc_project,
    BIMSCORIGINATOR=bimsc_originator,
    BIMSCVOLUME=bimsc_volume,
    BIMSCTYPE="INFLATABLES",
    BIMSCMATERIAL="Inflatable",
    RenderMaterial=dso.Inflatable,
    BIMSCPHASE=phase_3,
    selectedKitName="Objects")
name_4 = ExtendSpeckleObject(
    SpeckleObject=sso_6,
    BIMSCPROJECT=bimsc_project,
    BIMSCORIGINATOR=bimsc_originator,
    BIMSCVOLUME=bimsc_volume,
    BIMSCTYPE="STRUCTURE",
    BIMSCMATERIAL="Steel",
    RenderMaterial=dso.Steel,
    BIMSCPHASE=phase_3,
    selectedKitName="Objects")
in = CreateSpeckleObject(Inflatables=name_3, Structure=name_4, Window=name_2, selectedKitName="Objects")

# ---- group: Units_Habi
debrep_4 = DeconstructBrep(Brep=split.Negative)  # -> Faces, Edges, Vertices
area_5 = Area(Geometry=debrep_4.Faces)  # -> Area, Centroid
pdecon_5 = Deconstruct(Point=area_5.Centroid)  # -> XComponent, YComponent, ZComponent
int_6 = Integer(pdecon_5.ZComponent)
bnd_5 = Bounds(Numbers=int_6)
dedomain_5 = DeconstructDomain(Domain=bnd_5)  # -> Start, End
equals_5 = Equality(FirstNumber=int_6, SecondNumber=dedomain_5.Start)  # -> Equality, Inequality
cull_5 = CullPattern(List=area_5.Centroid, CullPattern=equals_5.Equality)  # -> simplify(List)
pln_5 = Plane(flatten(cull_5))

pln_6 = Plane(flatten(cull_5))

# ----
# HABITAD UNITS
# ASSEMBLY PHASE 6
expblock_2 = ExplodeBlock(Block=bang.Branch0, recursive=False)  # -> Name, Transform, Geometry
detatt_2 = DetachAttributes(Geometry=expblock_2.Geometry)  # -> Geometry, Attributes
volume_4 = Volume(Geometry=detatt_2.Geometry)  # -> Volume, Centroid
cset_5 = CreateSet(List=volume_4.Volume)  # -> Set, Map
cset_6 = CreateSet(List=cset_5.Map)  # -> Set, Map
mindex_3 = MemberIndex(Set=cset_5.Map, Member=cset_6.Set)  # -> Index, Count
item_5 = ListItem(List=detatt_2.Geometry, Index=mindex_3.Index, Wrap=True)  # -> simplify(Item)
bang_5 = ExplodeTree(Data=item_5)  # -> Branch0, Branch1, Branch2
sso_7 = BlockDefinition(
    Name="Glass",
    Geometry=bang_5.Branch2,
    BasePoint=bang_3.Branch1,
    SelectedConstructorName="Objects.Other.BlockDefinition.ctor(System.String,System.Collections.Generic.List`1[Speckle.Core.Models.Base],Objects.Geometry.Point)",
    SelectedTypeName="Objects.Other.BlockDefinition",
    UseSchemaTag=False,
    UserSetSchemaTag=False,
    seed="ff8e895b96f4344e5bea")
sso_8 = BlockDefinition(
    Name="Inflatable",
    Geometry=bang_5.Branch1,
    BasePoint=bang_3.Branch0,
    SelectedConstructorName="Objects.Other.BlockDefinition.ctor(System.String,System.Collections.Generic.List`1[Speckle.Core.Models.Base],Objects.Geometry.Point)",
    SelectedTypeName="Objects.Other.BlockDefinition",
    UseSchemaTag=False,
    UserSetSchemaTag=False,
    seed="74c7ac9f915255a3e209")
sso_9 = BlockDefinition(
    Name="Steel",
    Geometry=bang_5.Branch0,
    BasePoint=bang_3.Branch0,
    SelectedConstructorName="Objects.Other.BlockDefinition.ctor(System.String,System.Collections.Generic.List`1[Speckle.Core.Models.Base],Objects.Geometry.Point)",
    SelectedTypeName="Objects.Other.BlockDefinition",
    UseSchemaTag=False,
    UserSetSchemaTag=False,
    seed="6d6048d8a75f62682faf")
orient_2 = Orient(Geometry=bang.Branch0, Source=bang_3.Branch0, Target=pln_6)  # -> Geometry, Transform
sso_10 = BlockInstance(
    BlockDefinition=sso_7,
    Transform=orient_2.Transform,
    SelectedConstructorName="Objects.Other.BlockInstance.ctor(Objects.Other.BlockDefinition,Objects.Other.Transform)",
    SelectedTypeName="Objects.Other.BlockInstance",
    UseSchemaTag=False,
    UserSetSchemaTag=False,
    seed="741531741e3be19cb2c0")
sso_11 = BlockInstance(
    BlockDefinition=sso_8,
    Transform=orient_2.Transform,
    SelectedConstructorName="Objects.Other.BlockInstance.ctor(Objects.Other.BlockDefinition,Objects.Other.Transform)",
    SelectedTypeName="Objects.Other.BlockInstance",
    UseSchemaTag=False,
    UserSetSchemaTag=False,
    seed="5ef6fa26b8afc923a02a")
sso_12 = BlockInstance(
    BlockDefinition=sso_9,
    Transform=orient_2.Transform,
    SelectedConstructorName="Objects.Other.BlockInstance.ctor(Objects.Other.BlockDefinition,Objects.Other.Transform)",
    SelectedTypeName="Objects.Other.BlockInstance",
    UseSchemaTag=False,
    UserSetSchemaTag=False,
    seed="2b6654ad513ddd9dd323")
name_5 = ExtendSpeckleObject(
    SpeckleObject=sso_10,
    BIMSCPROJECT=bimsc_project,
    BIMSCORIGINATOR=bimsc_originator,
    BIMSCVOLUME=bimsc_volume,
    BIMSCTYPE="STRUCTURE",
    BIMSCMATERIAL="Glass",
    RenderMaterial=dso.Glass,
    BIMSCPHASE=phase_4,
    selectedKitName="Objects")
name_6 = ExtendSpeckleObject(
    SpeckleObject=sso_11,
    BIMSCPROJECT=bimsc_project,
    BIMSCORIGINATOR=bimsc_originator,
    BIMSCVOLUME=bimsc_volume,
    BIMSCTYPE="INFLATABLES",
    BIMSCMATERIAL="Inflatable",
    RenderMaterial=dso.Inflatable,
    BIMSCPHASE=phase_4,
    selectedKitName="Objects")
name_7 = ExtendSpeckleObject(
    SpeckleObject=sso_12,
    BIMSCPROJECT=bimsc_project,
    BIMSCORIGINATOR=bimsc_originator,
    BIMSCVOLUME=bimsc_volume,
    BIMSCTYPE="STRUCTURE",
    BIMSCMATERIAL="Steel",
    RenderMaterial=dso.Steel,
    BIMSCPHASE=phase_4,
    selectedKitName="Objects")
in_2 = CreateSpeckleObject(Inflatables=name_6, Structure=name_7, Window=name_5, selectedKitName="Objects")

# ----
# SUPPORT UNITS
# ASSEMBLY PHASE 7
expblock_3 = ExplodeBlock(Block=bang.Branch2, recursive=False)  # -> Name, Transform, Geometry
detatt_3 = DetachAttributes(Geometry=expblock_3.Geometry)  # -> Geometry, Attributes
volume_5 = Volume(Geometry=detatt_3.Geometry)  # -> Volume, Centroid
cset_7 = CreateSet(List=volume_5.Volume)  # -> Set, Map
cset_8 = CreateSet(List=cset_7.Map)  # -> Set, Map
mindex_4 = MemberIndex(Set=cset_7.Map, Member=cset_8.Set)  # -> Index, Count
item_6 = ListItem(List=detatt_3.Geometry, Index=mindex_4.Index, Wrap=True)  # -> simplify(Item)
bang_6 = ExplodeTree(Data=item_6)  # -> Branch0, Branch1, Branch2
sso_13 = BlockDefinition(
    Name="Glass",
    Geometry=bang_6.Branch2,
    BasePoint=bang_3.Branch1,
    SelectedConstructorName="Objects.Other.BlockDefinition.ctor(System.String,System.Collections.Generic.List`1[Speckle.Core.Models.Base],Objects.Geometry.Point)",
    SelectedTypeName="Objects.Other.BlockDefinition",
    UseSchemaTag=False,
    UserSetSchemaTag=False,
    seed="c00390b6159f8939e4fd")
sso_14 = BlockDefinition(
    Name="Inflatable",
    Geometry=bang_6.Branch1,
    BasePoint=bang_3.Branch2,
    SelectedConstructorName="Objects.Other.BlockDefinition.ctor(System.String,System.Collections.Generic.List`1[Speckle.Core.Models.Base],Objects.Geometry.Point)",
    SelectedTypeName="Objects.Other.BlockDefinition",
    UseSchemaTag=False,
    UserSetSchemaTag=False,
    seed="e98ffe5e9bfe795355b2")
sso_15 = BlockDefinition(
    Name="Steel",
    Geometry=bang_6.Branch0,
    BasePoint=bang_3.Branch2,
    SelectedConstructorName="Objects.Other.BlockDefinition.ctor(System.String,System.Collections.Generic.List`1[Speckle.Core.Models.Base],Objects.Geometry.Point)",
    SelectedTypeName="Objects.Other.BlockDefinition",
    UseSchemaTag=False,
    UserSetSchemaTag=False,
    seed="19cce9d17a2992b002e5")
orient_3 = Orient(Geometry=bang.Branch2, Source=bang_3.Branch2, Target=pln_2)  # -> Geometry, Transform
sso_16 = BlockInstance(
    BlockDefinition=sso_13,
    Transform=orient_3.Transform,
    SelectedConstructorName="Objects.Other.BlockInstance.ctor(Objects.Other.BlockDefinition,Objects.Other.Transform)",
    SelectedTypeName="Objects.Other.BlockInstance",
    UseSchemaTag=False,
    UserSetSchemaTag=False,
    seed="95800f53cba6afedca5a")
sso_17 = BlockInstance(
    BlockDefinition=sso_14,
    Transform=orient_3.Transform,
    SelectedConstructorName="Objects.Other.BlockInstance.ctor(Objects.Other.BlockDefinition,Objects.Other.Transform)",
    SelectedTypeName="Objects.Other.BlockInstance",
    UseSchemaTag=False,
    UserSetSchemaTag=False,
    seed="6ac40892a254094ba5bf")
sso_18 = BlockInstance(
    BlockDefinition=sso_15,
    Transform=orient_3.Transform,
    SelectedConstructorName="Objects.Other.BlockInstance.ctor(Objects.Other.BlockDefinition,Objects.Other.Transform)",
    SelectedTypeName="Objects.Other.BlockInstance",
    UseSchemaTag=False,
    UserSetSchemaTag=False,
    seed="56e02fcb1ef79a18a3fe")
name_8 = ExtendSpeckleObject(
    SpeckleObject=sso_16,
    BIMSCPROJECT=bimsc_project,
    BIMSCORIGINATOR=bimsc_originator,
    BIMSCVOLUME=bimsc_volume,
    BIMSCTYPE="STRUCTURE",
    BIMSCMATERIAL="Glass",
    RenderMaterial=dso.Glass,
    BIMSCPHASE=phase_2,
    selectedKitName="Objects")
name_9 = ExtendSpeckleObject(
    SpeckleObject=sso_17,
    BIMSCPROJECT=bimsc_project,
    BIMSCORIGINATOR=bimsc_originator,
    BIMSCVOLUME=bimsc_volume,
    BIMSCTYPE="INFLATABLES",
    BIMSCMATERIAL="Inflatable",
    RenderMaterial=dso.Inflatable,
    BIMSCPHASE=phase_2,
    selectedKitName="Objects")
name_10 = ExtendSpeckleObject(
    SpeckleObject=sso_18,
    BIMSCPROJECT=bimsc_project,
    BIMSCORIGINATOR=bimsc_originator,
    BIMSCVOLUME=bimsc_volume,
    BIMSCTYPE="STRUCTURE",
    BIMSCMATERIAL="Steel",
    RenderMaterial=dso.Steel,
    BIMSCPHASE=phase_2,
    selectedKitName="Objects")
in_3 = CreateSpeckleObject(Inflatables=name_9, Structure=name_10, Window=name_8, selectedKitName="Objects")

# ----
# MERGED UNITS
in_4 = CreateSpeckleObject(Units_Buffer=in, Units_Habi=in_2, Units_Support=in_3, selectedKitName="Objects")

# ----
# 01 //Create Revit Materials from Rhino M Properties
trigger = Trigger(Interval=1000, TimerInterval=1000, Target=[material, graphics])  # disabled

# ----
# 02// Create New Unit Revit Family
trigger_2 = Trigger(Interval=1000, TimerInterval=1000, Target=[new, famform, materials, active])  # disabled

# ----
# SEND TO REVIT MODEL
# The figures in the circles from the trigger component
# for the revit families to work have to be from left to right:
# a triangle (play), a pointer (mouse), and a key.
# //Send Topo Meshes to Revit
trigger_3 = Trigger(Interval=1000, TimerInterval=1000, Target=topography)  # disabled

# ----
# 03//Add Units to Revit
trigger_4 = Trigger(Interval=1000, TimerInterval=1000, Target=[types, l_component, l_component_2, l_component_3])  # disabled

# ----
# G06 wip branch
# https://macad.speckle.xyz/projects/4975f9f0a8/models/0c407c0907
panel_8 = Panel("G06_WIPdModel_V17")

# ----
# G06 shared branch
# https://macad.speckle.xyz/projects/4975f9f0a8/models/37a2354197
panel_9 = Panel("G06_AssembledModel_V7")

# ----
# G06_test_Unreal
# https://macad.speckle.xyz/streams/5e4e4e4563
panel_10 = Panel("G06_UnrealdModel_V1")

# ----
# G6_STUDIO_MAIN_MODEL
# https://macad.speckle.xyz/projects/4975f9f0a8/models/37a2354197
panel_11 = Panel("G06_AssembledModel_V4")

# ----
# //Send block instances to Revit
block_info_2 = GetBlockInfo(Block=reflay)  # -> Name, Plane, Transform, BlockType, FilePath, Active
orient_4 = Orient(Geometry=reflay, Source=block_info_2.Plane, Target=PlaneXY(0, 0, 0))  # -> Geometry, Transform
expblock_4 = ExplodeBlock(Block=orient_4.Geometry, recursive=False)  # -> Name, Transform, Geometry

# ----
# //Query materials' names using Elefront
geo = Geometry(expblock_4.Geometry)
ef_att = EleFrontAttributes(Attributes=geo)
ef_layer = EleFrontLayer(Layer=ef_att)
ef_layer_2 = EleFrontLayer(Layer=ef_layer)

split_2 = TextSplit(Text=ef_layer, Separators="::")
item_7 = ListItem(List=split_2, Index=-1, Wrap=True)
concat_2 = Concatenate(FragmentA="M-", FragmentB=item_7)  # -> simplify(Result)
pshift = ShiftPaths(Data=concat_2, Offset=-1)

# ----
# 02// Create new component family
materials = QueryMaterials(Name=pshift)  # disabled
add_link_to_revit_family_in_from_your_la = Panel("C:\Users\ARoncal\OneDrive - Thornton Tomasetti, Inc\__License Resources\Desktop\G06_studio_2024\Final\documentation\FTemplate_GEN_.rft")  # "Add Link to Revit Family in from your laptop. [Final / Documentation]"; disabled
famform = ComponentFamilyForm(Brep=graft(geo), Material=materials)  # disabled
active = ActiveDocument()  # disabled
toggle = BooleanToggle(True)  # disabled
shift = ShiftPaths(Data=famform, Offset=-1)  # disabled
new = NewComponentFamily(
    Document=active,
    Template=add_link_to_revit_family_in_from_your_la,
    Overwrite=toggle,
    Name=simplify(expblock_4.Name),
    Geometry=simplify(shift))  # disabled

# ----
# 03//Add components to RH Planes
types = QueryTypes(Document=active, Kind=3, FamilyName=expblock_4.Name)  # disabled
bang_7 = ExplodeTree(Data=types)  # -> Branch0, Branch1, Branch2; disabled
l_component = AddComponentLocation(Document=active, Location=simplify(pln), Type=simplify(bang_7.Branch0), TrackingMode=2)  # disabled
l_component_2 = AddComponentLocation(Document=active, Location=simplify(pln_5), Type=simplify(bang_7.Branch1), TrackingMode=2)  # disabled
l_component_3 = AddComponentLocation(Document=active, Location=simplify(pln_3), Type=simplify(bang_7.Branch2), TrackingMode=2)  # disabled

# ----
# ADD COURTYARD PODS
# ASSEMBLY PHASE 3
panel_12 = Panel("Pods")
reflay_4 = ReferenceByLayer(LayerName=panel_12, lightweight=False, DisableAutoUpdate=False)
mesh_3 = MeshBrep(
    Brep=reflay_4,
    Settings={GridMaxCount=0, GridMinCount=16, JaggedSeams=False, MaxEdgeLength=0, MinEdgeLength=0.0001, MinTolerance=0, Refine=True, RefineAngle=0, RelativeTolerance=0.65, SimplePlanes=True, Tolerance=0})
brep = Brep(reflay_4)
mjoin = MeshJoin(Meshes=mesh_3)
weld = WeldMesh(Mesh=mjoin, Angle=3.141592654)
filter_2 = StreamFilter(Gate=list, Stream0=brep, Stream1=weld)
cso_2 = CreateSpeckleObject(Pods=filter_2, selectedKitName="Objects")
phase_6 = Panel(num_3)

# ----
# EDIT SITE MESH
# ASSEMBLY PHASE 1
panel_13 = Panel("https://macad.speckle.xyz/streams/4975f9f0a8/branches/site/04-community-site")
receive_2 = Receive(
    Stream=panel_13,
    AutoReceive=False,
    CurrentComponentState="up_to_date",
    ExpandOutput=True,
    LastInfoMessage="James McBennett @ 03/01/2024 23:14:17: 2024 Mar-01 (id:9ec35295b2)",
    ReceiveOnOpen=False,
    ReceivedCommitId="9ec35295b2",
    StreamWrapper="https://macad.speckle.xyz/projects/4975f9f0a8/models/site/04-community-site",
    selectedKitName="Objects")  # -> Info, CONTOURS, SOIL
item_8 = ListItem(List=flatten(receive_2.SOIL), Index=Slider(3, range=0..17), Wrap=True)
srf = Surface(<surface referenced from the Rhino model>)
bbox = BoundingBox(Content=srf, Plane=PlaneXY(0, 0, 0))  # -> Box, Box_2
volume_6 = Volume(Geometry=bbox.Box)  # -> Volume, Centroid
msphere = MeshSphere(Base=volume_6.Centroid, Radius="80", UCount="100", VCount="100")
msplit = MeshSplit(Mesh=item_8, Splitters=msphere)
item_9 = ListItem(List=msplit, Index=Slider(0, range=0..1), Wrap=True)

# ----
# ADD SITE TERRAIN
# ASSEMBLY PHASE 1
panel_14 = Panel("TopoMesh")
reflay_5 = ReferenceByLayer(LayerName="TopoBrep", lightweight=False, DisableAutoUpdate=False)
reflay_6 = ReferenceByLayer(LayerName=panel_14, lightweight=False, DisableAutoUpdate=False)
filter_3 = StreamFilter(Gate=list, Stream0=reflay_5, Stream1=reflay_6)
msplit_2 = MeshSplit(Mesh=filter_3, Splitters=msphere)
item_10 = ListItem(List=msplit_2, Index=Slider(1, range=0..1), Wrap=True)
cso_3 = CreateSpeckleObject(Terrain=item_10, selectedKitName="Objects")
name_11 = ExtendSpeckleObject(
    SpeckleObject=cso_3,
    BIMSCPROJECT=bimsc_project,
    BIMSCORIGINATOR=bimsc_originator,
    BIMSCVOLUME=bimsc_volume,
    BIMSCTYPE="TERRAIN",
    BIMSCMATERIAL="soil",
    RenderMaterial=dso.Soil,
    BIMSCPHASE=phase_5,
    selectedKitName="Objects")  # -> flatten(ExtendedSpeckleObject)

cso_4 = CreateSpeckleObject(Site=item_9, selectedKitName="Objects")

name_12 = ExtendSpeckleObject(
    SpeckleObject=cso_4,
    BIMSCPROJECT=bimsc_project,
    BIMSCORIGINATOR=bimsc_originator,
    BIMSCVOLUME=bimsc_volume,
    BIMSCTYPE="SITE",
    BIMSCMATERIAL="soil",
    RenderMaterial=dso.Soil,
    BIMSCPHASE=phase_5,
    selectedKitName="Objects")  # -> flatten(ExtendedSpeckleObject)

# ----
# //Send topo meshes to Revit
number_slider_2 = Slider(9, range=0..10)
mesh_4 = Mesh(reflay_6)
unweld = UnweldMesh(Mesh=mesh_4, Angle=degrees(number_slider_2))
topography = AddTopographyMesh(Mesh=unweld, TrackingMode=2)  # disabled

# ----
# ADD UNITS FLOOR
# ASSEMBLY PHASE 2
panel_15 = Panel("Floors")
reflay_7 = ReferenceByLayer(LayerName=panel_15, lightweight=False, DisableAutoUpdate=False)
mesh_5 = MeshBrep(
    Brep=reflay_7,
    Settings={GridMaxCount=0, GridMinCount=16, JaggedSeams=False, MaxEdgeLength=0, MinEdgeLength=0.0001, MinTolerance=0, Refine=True, RefineAngle=0, RelativeTolerance=0.65, SimplePlanes=True, Tolerance=0})
mjoin_2 = MeshJoin(Meshes=mesh_5)
weld_2 = WeldMesh(Mesh=mjoin_2, Angle=3.141592654)
brep_2 = Brep(reflay_7)
filter_4 = StreamFilter(Gate=list, Stream0=brep_2, Stream1=weld_2)
phase_7 = Panel(num_2)

cso_5 = CreateSpeckleObject(UnitsFloors=filter_4, selectedKitName="Objects")

name_13 = ExtendSpeckleObject(
    SpeckleObject=cso_5,
    BIMSCPROJECT=bimsc_project,
    BIMSCORIGINATOR=bimsc_originator,
    BIMSCVOLUME=bimsc_volume,
    BIMSCTYPE="FLOORS",
    BIMSCMATERIAL="Regolith",
    RenderMaterial=dso.Regolith,
    BIMSCPHASE=phase_7,
    selectedKitName="Objects")  # -> flatten(ExtendedSpeckleObject)

name_14 = ExtendSpeckleObject(
    SpeckleObject=cso_2,
    BIMSCPROJECT=bimsc_project,
    BIMSCORIGINATOR=bimsc_originator,
    BIMSCVOLUME=bimsc_volume,
    BIMSCTYPE="PODS",
    BIMSCMATERIAL="Regolith",
    RenderMaterial=dso.Regolith,
    BIMSCPHASE=phase_6,
    selectedKitName="Objects")  # -> flatten(ExtendedSpeckleObject)

# ----
# ADD WALLS
# ASSEMBLY PHASE 4
panel_16 = Panel("Wall")
reflay_8 = ReferenceByLayer(LayerName=panel_16, lightweight=False, DisableAutoUpdate=False)
mesh_6 = MeshBrep(
    Brep=reflay_8,
    Settings={GridMaxCount=0, GridMinCount=16, JaggedSeams=False, MaxEdgeLength=0, MinEdgeLength=0.0001, MinTolerance=0, Refine=True, RefineAngle=0, RelativeTolerance=0.65, SimplePlanes=True, Tolerance=0})
brep_3 = Brep(reflay_8)
mjoin_3 = MeshJoin(Meshes=mesh_6)
weld_3 = WeldMesh(Mesh=mjoin_3, Angle=3.141592654)
filter_5 = StreamFilter(Gate=list, Stream0=brep_3, Stream1=weld_3)  # -> reverse(simplify(graft(Stream)))
phase_8 = Panel(num_4)

cso_6 = CreateSpeckleObject(Wall=filter_5, selectedKitName="Objects")

name_15 = ExtendSpeckleObject(
    SpeckleObject=cso_6,
    BIMSCPROJECT=bimsc_project,
    BIMSCORIGINATOR=bimsc_originator,
    BIMSCVOLUME=bimsc_volume,
    BIMSCTYPE="WALLS",
    BIMSCMATERIAL="Regolith",
    RenderMaterial=dso.Regolith,
    BIMSCPHASE=phase_8,
    selectedKitName="Objects")

# ----
# SEND TO SPLECKLE STREAMS
cso_7 = CreateSpeckleObject(
    ROOF=name,
    WALL=name_15,
    FLOORS=name_13,
    PODS=name_14,
    UNITS=in_4,
    TERRAIN=name_11,
    SITE_A4=name_12,
    selectedKitName="Objects")

# ----
# Always Leave Send Component Unplugged
# in the stream input before closing and
# saving this gh file
send = Send(
    Message=panel_9,
    D=cso_7,
    AutoSend=False,
    BaseId="436ad55fc1a3afb78a65736d4b8fa661",
    CurrentComponentState="sending",
    KitName="Objects",
    OutputWrappers="https://macad.speckle.xyz\t4975f9f0a8\t8bb716a88b",
    UseDefaultCache=True,
    selectedKitName="Objects")
rec = DataRecorder(send, DataLimit=-10, RecordData=True)
panel_17 = Panel(rec)

# ----
# 01 //Create Revit materials from Rhino M Properties
cset_9 = CreateSet(List=flatten(pshift))  # -> Set, Map; disabled
material = AddMaterial(Name=cset_9.Set, TrackingMode=2)  # disabled

# ---- group: MaterialProperties
python = GhPythonScript(Mname=cset_9.Set)  # -> out, Pvalue, Pname; disabled
# ---------- python: Python ----------
__author__ = "hesham.shawqy"
__version__ = "2024.02.25"

import rhinoscriptsyntax as rs
import Rhino.DocObjects as rd
import Rhino as rh

def get_material_properties(Mname):
    # Get the active Rhino document
    doc = rh.RhinoDoc.ActiveDoc
    
    # Search for the material by name
    material_index = doc.Materials.Find(Mname, True)
    if material_index < 0:
        print("Material not found.")
        return None
    
    # Retrieve the material object
    material = doc.Materials[material_index]
    
    # Extract material properties
    properties = {
        "DiffuseColor": material.DiffuseColor,
        "Transparency": material.Transparency,
        # Add more properties as needed
    }
    
    return properties

Pname = []
Pvalue = []
material_properties = get_material_properties(Mname)
if material_properties:
    for prop, value in material_properties.items():
        Pvalue.append(value)
        Pname.append(prop)
# ---------- end python ----------

# ----
item_11 = ListItem(List=simplify(python.Pvalue), Index=0, Wrap=True)  # -> Item, Item1; disabled
graphics = MaterialGraphics(
    Material=simplify(graft(material)),
    Color=item_11.Item,
    Transparency=item_11.Item1,
    ForegroundPatternCutPatterns=<geometry referenced from the Revit model>)  # -> Material, UseRenderAppearance, Color, Transparency, SurfacePatternsForegroundPattern, SurfacePatternsForegroundColor, CutPatternsForegroundPattern, CutPatternsForegroundColor; disabled
